vi "Main.gvi"   [LabVIEW NXG 3.1.0]
panel controls:
  "Stop": bool
  "Open Link": bool
  "Word Index": f64
  "Random Word": bool
  "Save": bool
  "Insert Word": bool
panel indicators:
  "# Vocab Words Stored": f64
  "Header (Current Mode)": string
  "Definition": string
  "Word": string
  "Resource Link": path
diagram:
  w1 = "Init"  # Program State
  w2 = no error  # Error
  s1 = w1  # shift register
  s2 = uninitialised  # shift register
  s3 = w2  # shift register
  s4 = uninitialised  # shift register
  s5 = FALSE  # shift register
  while {
    # s5: Close?
    # s1: State
    # s2: Vocab CSV
    # s4: Vocab Data
    case (s1) {
      frame "Init" {
        w8 = "Wait For Event"  # Program State
        Open Or Create Or Replace File(error in=s3, file path (use dialog)=path "VocabWords.csv", operation (0:open)="open or create") -> (error out=w9, refnum out=w10)
        Read From Text File(error in=w9, file (use dialog)=w10) -> (error out=w11, refnum out=w3, text=w12)
        call "InitVocabArray.gvi"(text from File=w12, Error In=w11) -> (VocabArray=w6, Error Out=w4)
        w5 = w8
        w7 = s5
      }
      frame "Wait For Event", Default {
        event (after s2) (after s1) (after s5) (after s3) {
          on "Word Index" Value changed {
            $"Header (Current Mode)" <- "Manual Word Mode"
            w13 = "Wait For Event"  # Program State
            Event Data() -> ("New Value"=w14)
            Array Index(array=s4) -> (out0[w14]=w15)
            Property Node(instance in=w15) -> ("Word"=w16, "Definition"=w17, "Resource Link"=w18)
            $Word <- w16
            $Definition <- w17
            $"Resource Link" <- w18
            w5 = w13
          }
        }
        w3 = _
        w4 = _
        w6 = _
        w7 = _
      }
      frame "Manual" {
        w3 = _
        w4 = _
        w5 = _
        w6 = _
        w7 = _
      }
      frame "Random" {
        w3 = _
        w4 = _
        w5 = _
        w6 = _
        w7 = _
      }
      frame "Insert" {
        w3 = _
        w4 = _
        w5 = _
        w6 = _
        w7 = _
      }
      frame "Error Handler" {
        w3 = _
        w4 = _
        w5 = _
        w6 = _
        w7 = _
      }
      frame "Exit" {
        w3 = _
        w4 = _
        w5 = _
        w6 = _
        w7 = TRUE
      }
    }
    next s1 = w5
    next s2 = w3
    next s3 = w4
    next s4 = w6
    next s5 = w7
    stop if w7
  }
